# Grasshopper definition get_features_by_color.gh (Grasshopper 1.0.8)
# plug-ins: RhinoCodePluginGH, Pufferfish

imagebounds = Curve(<curve referenced from the Rhino model>)
curve = Curve([<curve referenced from the Rhino model> x6])

# ---- group: Return
file_path = FilePath("C:\Users\andre\Downloads\back.pkl")
viewpredictions = ViewPredictions(bake=Button(), filepath=file_path)

# ---- group: Assumes images are in same parent folder as the .3dm file
python_3_script = Python3Script()  # -> out, normalMap_location, zBuffer_location, main_location, pickle_name
# ---------- python_3_script: Python ----------
from Rhino import RhinoDoc
a  = RhinoDoc.ActiveDoc.Path
x = a.rpartition("\\")[0]
normalMap_location = x + "\\normal.jpg"
zBuffer_location = x + "\\zbuffer.jpg"
main_location = x + "\\"
y = a.rpartition("\\")[2]
pickle_name = y[0:-4]
# ---------- end python_3_script ----------

# ----
panel = Panel(python_3_script.pickle_name)
panel_2 = Panel(python_3_script.main_location)
normalmap_image_location = FilePath(python_3_script.normalMap_location)
imagebounds_2 = Curve(imagebounds)
zbuffer_image_location = FilePath(python_3_script.zBuffer_location)
imagebounds_3 = Curve(imagebounds)

# ---- group: Get Feature - Curve Type
panel_3 = Panel(curve)
getcrvtype = Python3Script(desc=panel_3)  # -> out, a; inputs desc: list of String
# ---------- getcrvtype: Python ----------
# Truncate labels by removing "Referenced..."
for i in range(len(desc)):
    desc[i] = (desc[i])[11:]
a = desc
print(desc)
# ---------- end getcrvtype ----------

# ----
getcrvattributes = Python3Script(crv=curve)  # -> degree, deformable, periodic, span_count; inputs crv: list of Curve
# ---------- getcrvattributes: Python ----------
import Rhino
degree = [] # a list of ints
deformable = [] # a list of bools
periodic = [] # a list of bools
span_count = []
for i in crv:
    degree.append(i.Degree)
    deformable.append(i.IsDeformable)
    periodic.append(i.IsPeriodic)
    span_count.append(i.SpanCount)
# ---------- end getcrvattributes ----------
getlabel = GetLabel(object_or_attributes=curve)
iscrvclosed = IsCrvClosed(C=curve)
crvlengthnormalised = CrvLengthNormalised(C=curve)
list_indices = ListIndices(List=curve)
crvdistancefrompage = CrvDistancefromPage(C=curve, G=curve)
ctrlptcount = CtrlPtCount(C=curve)
normalmap = NormalMap(C=curve, F=normalmap_image_location, R=imagebounds_2)
zbuffer = ZBuffer(C=curve, F=zbuffer_image_location, R=imagebounds_3)
guid = Guid(curve)
panel_4 = Panel(guid)

pickler = Python3Script(
    labels=getlabel,
    crv_type=getcrvtype.a,
    crv_closed=iscrvclosed,
    crv_len=crvlengthnormalised,
    crv_deg=getcrvattributes.degree,
    crv_def=getcrvattributes.deformable,
    crv_per=getcrvattributes.periodic,
    crv_span=getcrvattributes.span_count,
    crv_ctrl=ctrlptcount,
    crv_dist=crvdistancefrompage,
    crv_norm=normalmap,
    crv_zbuff=zbuffer,
    crv_rid=panel_4,
    crv_ind=list_indices,
    name=panel,
    path=panel_2,
    save_file=Button())  # -> out, save; inputs labels: list, crv_type: list, crv_closed: list, crv_len: list, crv_deg: list, crv_def: list, crv_per: list, crv_span: list, crv_ctrl: list, crv_dist: list, crv_norm: list, crv_zbuff: list, crv_rid: list of String, crv_ind: list
# ---------- pickler: Python ----------
"""
data = {
"labels": labels,
"crv_type": crv_type,
"crv_closed": crv_closed,
"crv_len": crv_len,
"crv_deg": crv_deg,
"crv_def": crv_def,
"crv_per": crv_per,
"crv_span": crv_span,
"crv_ctrl": crv_ctrl,
"crv_dist": crv_dist,
"crv_norm": crv_norm,
"crv_zbuff": crv_zbuff,
"crv_rid": crv_rid,
"crv_ind": crv_ind
}

"""
data = [labels, crv_type, crv_closed, crv_len, crv_deg, crv_def, crv_per, crv_span, crv_ctrl, crv_dist, crv_norm, crv_zbuff, crv_rid, crv_ind]
# save the dictionary for use in pandas

"""
import pickle
# Open a file to save the data
with open("data2.pkl", "wb") as f:
    # Dump the data into the file
    pickle.dump(data, f)

import os
print(os.getcwd())
"""

import pickle
import os
save = path + name + ".pkl"
if save_file:
    pickle.dump(data, open(save, 'wb'))
# ---------- end pickler ----------
panel_5 = Panel(pickler.save)

# ==== cluster ViewPredictions
filepath = ClusterInput()
py3 = Python3Script(filePath=filepath)  # -> out, flatten(rids), lineweights
# ---------- py3: Python ----------
import pickle

with open(filePath, 'rb') as filein:
    back = pickle.load(filein) # 2d list

rids = back[0] # the rhino ids of the predicted curves
lineweights = back[1] # the predicted lineweight label
# ---------- end py3 ----------
createatts = CreateAttributes(
    Name=py3.lineweights,
    LayerName=py3.lineweights,
    Color=ColourSwatch(SwatchColor=RGB(255, 255, 255)),
    enableFullPath=False)
bake = ClusterInput()
bake_2 = BakeGeometry(Bake=bake, Geometry=py3.rids, Attributes=createatts, DeleteOldBakes=False, PreserveTrees=False)

# ==== cluster CrvDistancefromPage
C = ClusterInput()
G = ClusterInput()

# ---- group: Get Feature - Distance from Edge of Page
# Distance from edge of page - calculated using midpoint of curve and the bounding rectangle
midpt = CurveMiddle(Curve=C)
brec = BoundingRectangle(Geometry=G, Plane=PlaneXY(0, 0, 0), Axis=0, Slide=0, Union=True)  # -> Bounding, DimensionX, DimensionY
crv_cp = CurveClosestPoint(Point=midpt, Curve=brec.Bounding)  # -> Point, Parameter, Distance
dist = Distance(PointA=midpt, PointB=crv_cp.Point)
bnd = Bounds(Numbers=dist)
remap = RemapNumbers(Value=dist, Source=bnd, Target=Domain(0, 1))  # -> Mapped, Clipped

# ----
C_2 = ClusterOutput(remap.Clipped)

# ==== cluster CtrlPtCount
C = ClusterInput()
cp = ControlPoints(Curve=C)  # -> Points, Weights, Knots
lng = ListLength(List=cp.Points)  # -> flatten(Length)
L = ClusterOutput(lng)
panel = Panel(lng)

# ==== cluster CrvLengthNormalised
C = ClusterInput()

# ---- group: Get Feature - Length
len = Length(Curve=C)
bnd = Bounds(Numbers=len)
remap = RemapNumbers(Value=len, Source=bnd, Target=Domain(0, 1))  # -> Mapped, Clipped

# ----
C_2 = ClusterOutput(remap.Clipped)

# ==== cluster IsCrvClosed
C = ClusterInput()

# ---- group: Get Feature - Curve Closed?
cls = Closed(Curve=C)  # -> Closed, Periodic
num = Number(cls.Closed)

# ----
num_2 = ClusterOutput(num)

# ==== cluster NormalMap
F = ClusterInput()
R = ClusterInput()
C = ClusterInput()
img = ImportImage(File=F, Rectangle=R)
end = EndPoints(Curve=C)  # -> Start, End
meshcp = MeshClosestPoint(Point=end.Start, Mesh=img)  # -> Point, Index, Parameter
meshcp_2 = MeshClosestPoint(Point=end.End, Mesh=img)  # -> Point, Index, Parameter
meval = MeshEval(Mesh=img, Parameter=meshcp_2.Parameter)  # -> Point, Normal, Colour
meval_2 = MeshEval(Mesh=img, Parameter=meshcp.Parameter)  # -> Point, Normal, Colour
argb = SplitARGB(Colour=meval_2.Colour)  # -> Alpha, Red, Green, Blue
argb_2 = SplitARGB(Colour=meval.Colour)  # -> Alpha, Red, Green, Blue
addition = Addition(A=argb.Red, B=argb_2.Alpha)
addition_2 = Addition(A=argb.Green, B=argb_2.Green)
addition_3 = Addition(A=argb.Blue, B=argb_2.Blue)
cmyk = ColourCMYK(Cyan=0, Magenta=0, Yellow=0, Key=0)
division = Division(A=addition, B="2")
division_2 = Division(A=addition_2, B="2")
division_3 = Division(A=addition_3, B="2")
frgb = ColourRGBF(Alpha=1, Red=division, Green=division_2, Blue=division_3)
vb = VBScript(rgb=frgb)  # -> out, hex; inputs rgb: Color
# ---------- vb: VB ----------
    'First recreate the colour from scratch to remove any naming associations.
    Dim col As Color = Color.FromARGB(rgb.R, rgb.G, rgb.B)
    hex = System.Drawing.ColorTranslator.ToHtml(col)
# ---------- end vb ----------
hex2int = Python3Script(x=vb.hex)  # -> out, a; inputs x: list
# ---------- hex2int: Python ----------
a = []
for i in range(len(x)):
    a.append(int(x[i][1:], 16))
# ---------- end hex2int ----------
a = ClusterOutput(hex2int.a)

# ==== cluster ZBuffer
F = ClusterInput()
R = ClusterInput()
C = ClusterInput()

# ---- group: Depth Map
img = ImportImage(File=F, Rectangle=R)
end = EndPoints(Curve=C)  # -> Start, End
meshcp = MeshClosestPoint(Point=end.Start, Mesh=img)  # -> Point, Index, Parameter
meshcp_2 = MeshClosestPoint(Point=end.End, Mesh=img)  # -> Point, Index, Parameter
meval = MeshEval(Mesh=img, Parameter=meshcp_2.Parameter)  # -> Point, Normal, Colour
meval_2 = MeshEval(Mesh=img, Parameter=meshcp.Parameter)  # -> Point, Normal, Colour
argb = SplitARGB(Colour=meval_2.Colour)  # -> Alpha, Red, Green, Blue
argb_2 = SplitARGB(Colour=meval.Colour)  # -> Alpha, Red, Green, Blue
addition = Addition(A=argb.Red, B=argb_2.Alpha)
addition_2 = Addition(A=argb.Green, B=argb_2.Green)
addition_3 = Addition(A=argb.Blue, B=argb_2.Blue)
division = Division(A=addition, B="2")
division_2 = Division(A=addition_2, B="2")
division_3 = Division(A=addition_3, B="2")
frgb = ColourRGBF(Alpha=1, Red=division, Green=division_2, Blue=division_3)
vb = VBScript(rgb=frgb)  # -> out, hex; inputs rgb: Color; same code as vb
hex2int = Python3Script(x=vb.hex)  # -> out, a; inputs x: list; same code as hex2int

# ----
a = ClusterOutput(hex2int.a)

# ==== cluster GetLabel
object_or_attributes = ClusterInput()
object_attributes = ObjectAttributes(ObjectOrAttributes=object_or_attributes)  # -> Name, LayerName, LayerFullPath, Color, MaterialName, LinetypeName, GroupIndices, PlotWeight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
colortolabel = Python3Script(x=object_attributes.Color)  # -> out, a; inputs x: list
# ---------- colortolabel: Python ----------
import rhinoscriptsyntax as rs
profile = rs.CreateColor(255, 0, 0)
contour = rs.CreateColor(0, 255, 0)
detail = rs.CreateColor(0, 0, 255)
cut = rs.CreateColor(255, 0, 255)

def colorEqual(col1, col2):
    if str(col1) == str(col2):
        return True
    else:
        return False

a = []
for i in range(len(x)):
    if colorEqual(x[i], profile):
        a.append("Profile")
    elif colorEqual(x[i], contour):
        a.append("Contour")
    elif colorEqual(x[i], detail):
        a.append("Detail")
    else:
        a.append("Cut")
# ---------- end colortolabel ----------
a = ClusterOutput(colortolabel.a)
