# Grasshopper definition nurbs_to_lst.gh (Grasshopper 1.0.8)
# plug-ins: RhinoCodePluginGH, Pufferfish

original_curves = Curve([<curve referenced from the Rhino model> x25])
opncrv = OpenCurve(Curve=original_curves, Length=1e-06, Normalized=False, Seam=0)  # -> Opened, R
cls = Closed(Curve=opncrv.Opened)  # -> Closed, Periodic
rebcrv = RebuildCurve(Curve=opncrv.Opened, Count=Slider(10, range=0..100), Degree=Slider(3, range=0..10), EndTangents=False)
cp = ControlPoints(Curve=rebcrv)  # -> Points, Weights, Knots
item = ListItem(List=rebcrv, Index=Slider(78, range=0..1000), Wrap=True)
py3 = Python3Script(ctrl=cp.Points, weight=cp.Weights, knot=cp.Knots)  # -> out, nurbs_crv; inputs ctrl: tree of Point3d, weight: tree, knot: tree
# ---------- py3: Python ----------
import ghpythonlib.components as ghcomp
import ghpythonlib.treehelpers as th

ctrl = th.tree_to_list(ctrl)
weight = th.tree_to_list(weight)
knot = th.tree_to_list(knot)

nurbs_crv = []
for i in range(len(ctrl)): # i == number of curves total
    for j in range(len(ctrl[0])): # j == number of ctrl points per crv
        current_pt = ctrl[i][j] # a list of x, y, z values
        nurbs_crv.append(current_pt[0])
        nurbs_crv.append(current_pt[1])
        nurbs_crv.append(current_pt[2])
    for l in range(len(weight[0])): #l == number of weights per crv
        nurbs_crv.append(weight[i][l])
    for k in range(len(knot[0])): # k == number of knots per crv
        nurbs_crv.append(knot[i][k])
# ---------- end py3 ----------
panel = Panel(cp.Points)
panel_2 = Panel(cp.Weights)
panel_3 = Panel(cp.Knots)
nurbcrv = NurbsCurvePWK()  # -> Curve, Length, Domain
lng = ListLength(List=panel_3)
lng_2 = ListLength(List=panel_2)
lng_3 = ListLength(List=panel)
panel_4 = Panel(lng)
panel_5 = Panel(lng_2)
panel_6 = Panel(lng_3)
