# Grasshopper definition get_rec_bounds_coordinates_v2.gh (Grasshopper 1.0.8)
# plug-ins: RhinoCodePluginGH, Pufferfish

pipeline = GeometryPipeline(
    GroupByLayer=False,
    GroupByType=False,
    IncludeHidden=True,
    IncludeLocked=True,
    LayerFilter="*",
    NameFilter="*",
    SublayerFiltering=True,
    TypeFilter=4)
pipeline_2 = GeometryPipeline(
    GroupByLayer=False,
    GroupByType=False,
    IncludeHidden=True,
    IncludeLocked=True,
    LayerFilter="*",
    NameFilter="*",
    SublayerFiltering=True,
    TypeFilter=1073741848)

# ---- group: The picture
srf = Surface(pipeline_2)

# ---- group: All the curves in the drawing
crv = Curve(pipeline)

# ----
brec = BoundingRectangle(Geometry=srf, Plane=PlaneXY(0, 0, 0), Axis=0, Slide=0, Union=True)  # -> Bounding, DimensionX, DimensionY
brec_2 = BoundingRectangle(Geometry=graft(crv), Plane=PlaneXY(0, 0, 0), Axis=0, Slide=0, Union=True)  # -> Bounding, DimensionX, DimensionY
path = FilePath("C:\Users\andre\Documents\lineweights\processed_data\normal_7.jpg")
area = Area(Geometry=brec_2.Bounding)  # -> Area, Centroid
dom = ConstructDomain(DomainStart="0", DomainEnd=brec.DimensionX)
dom_2 = ConstructDomain(DomainStart="0", DomainEnd=brec.DimensionY)
scale = Scale(Geometry=brec_2.Bounding, Center=area.Centroid, Factor=Slider(1.05, range=0..10))  # -> Geometry, Transform
py3 = Python3Script(img_loc=path)  # -> out, img_width, img_height
# ---------- py3: Python ----------
import System
img = System.Drawing.Bitmap.FromFile(img_loc)
img_width = img.Width
img_height = img.Height
# ---------- end py3 ----------
dom_3 = ConstructDomain(DomainStart="0", DomainEnd=py3.img_height)
dom_4 = ConstructDomain(DomainStart="0", DomainEnd=py3.img_width)
explode = Explode(Curve=scale.Geometry, Recursive=True)  # -> Segments, Vertices
id = Guid(crv)
getlabel = GetLabel(object_or_attributes=crv)
python_3_script = Python3Script(x=Toggle(True))  # -> out, normalMap_location, zBuffer_location, main_location, pickle_name
# ---------- python_3_script: Python ----------
if x == True:
    from Rhino import RhinoDoc
    a  = RhinoDoc.ActiveDoc.Path
    x = a.rpartition("\\")[0]
    import os
    x = os.path.basename(x)
    x = int(x)
    x = str(x)
    # x = int(x)
    # x = str(x)
    normalMap_location = x + "\\normal_" + x + ".jpg"
    zBuffer_location = x + "\\zbuffer.jpg"
    main_location = x + "\\"
    y = a.rpartition("\\")[2]
    pickle_name = y[0:-4]
# ---------- end python_3_script ----------
panel = Panel(python_3_script.pickle_name)

# ---- group: Top left
item = ListItem(List=explode.Vertices, Index=Slider(3, range=0..100), Wrap=True)
pdecon = Deconstruct(Point=item)  # -> XComponent, YComponent, ZComponent

# ---- group: Bottom right
item_2 = ListItem(List=explode.Vertices, Index=Slider(1, range=0..100), Wrap=True)
pdecon_2 = Deconstruct(Point=item_2)  # -> XComponent, YComponent, ZComponent
remap = RemapNumbers(Value=[pdecon.YComponent, pdecon_2.YComponent], Source=dom_2, Target=dom_3)  # -> simplify(Mapped), Clipped

# ---- group: Top left (continued)
remap_2 = RemapNumbers(Value=[pdecon.XComponent, pdecon_2.XComponent], Source=dom, Target=dom_4)  # -> simplify(Mapped), Clipped

# ----
panel_2 = Panel(remap_2.Mapped)
panel_3 = Panel(remap.Mapped)
int = Integer(panel_3)
int_2 = Integer(panel_2)
panel_4 = Panel(int)
panel_5 = Panel(int_2)
item_3 = ListItem(List=panel_5, Index="0", Wrap=True)
item_4 = ListItem(List=panel_4, Index="0", Wrap=True)
item_5 = ListItem(List=panel_5, Index="1", Wrap=True)
item_6 = ListItem(List=panel_4, Index="1", Wrap=True)
lng = ListLength(List=item_6)
# Subtract from the total height of the image (3330) to get the  y coordinate. Z coordinate can be ignored
py3_2 = Python3Script(
    x1=flatten(item_3),
    x2=flatten(item_5),
    y1=flatten(item_4),
    y2=flatten(item_6),
    num_boxes=lng,
    rid=flatten(id),
    lw_label=flatten(getlabel),
    img_height=py3.img_height,
    path="C:\Users\andre\Documents\lineweights\",
    name=panel,
    save_file=Button())  # -> out, data, save; inputs x1: list of Int32, x2: list of Int32, y1: list of Int32, y2: list of Int32, rid: list of String, lw_label: list, img_height: Int32
# ---------- py3_2: Python ----------
print(lw_label)
"""for i in range(num_boxes):
    y1[i] = img_height - y1[i]
    y2[i] = img_height - y2[i]"""

data = [x1, y1, x2, y2, rid, lw_label]

import pickle
import os
save = path + name + ".pkl"

if save_file:
    pickle.dump(data, open(save, 'wb'))
# ---------- end py3_2 ----------
panel_6 = Panel(py3_2.data)
panel_7 = Panel(py3_2.save)

# ==== cluster GetLabel
object_or_attributes = ClusterInput()
object_attributes = ObjectAttributes(ObjectOrAttributes=object_or_attributes)  # -> Name, LayerName, LayerFullPath, Color, MaterialName, LinetypeName, GroupIndices, PlotWeight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
colortolabel = Python3Script(x=object_attributes.Color)  # -> out, a; inputs x: list
# ---------- colortolabel: Python ----------
import rhinoscriptsyntax as rs
profile = rs.CreateColor(255, 0, 0)
contour = rs.CreateColor(0, 255, 0)
detail = rs.CreateColor(0, 0, 255)
cut = rs.CreateColor(255, 0, 255)

def colorEqual(col1, col2):
    if str(col1) == str(col2):
        return True
    else:
        return False

a = []
for i in range(len(x)):
    if colorEqual(x[i], profile):
        a.append("Profile")
    elif colorEqual(x[i], contour):
        a.append("Contour")
    elif colorEqual(x[i], detail):
        a.append("Detail")
    else:
        a.append("Cut")
# ---------- end colortolabel ----------
a = ClusterOutput(colortolabel.a)
